# Grasshopper definition Ex01_ElasticRod.gh (Grasshopper 1.0.8)
# plug-ins: ErodDataGH Info, ElasticRodGH Info

pt = ConstructPoint(XCoordinate=0, YCoordinate=0, ZCoordinate=0)
pt_2 = ConstructPoint(XCoordinate=Slider(10, range=0..10), YCoordinate=0, ZCoordinate=0)
number_slider = Slider(40, range=0..40)
ln = Line(StartPoint=pt, EndPoint=pt_2)
divide = DivideCurve(Curve=ln, Count=number_slider, Kinks=False)  # -> Points, Tangents, Parameters
# External Force
pline = PolyLine(Vertices=divide.Points, Closed=False)

division = Division(A=number_slider, B=2)
Z = UnitZ(Factor=Slider(0.1, range=0..0.1))
int = Integer(division)
item = ListItem(List=divide.Points, Index=int, Wrap=True)
unit = UnitVector(Vector=Z)
force = Force(Point=item, Vector=Z)
vdis = VectorDisplay(Anchor=item, Vector=unit)

# ----
# Material
number_slider_2 = Slider(21000, range=0..100000)
materialglobal = MaterialGlobal(
    E=number_slider_2,
    Nu=Slider(0.4, range=0..1),
    Width=Slider(0.2, range=0..1),
    Height=Slider(0.1, range=0..0.1),
    orientation=0)

# ----
# Support Conditions
item_2 = ListItem(List=divide.Points, Index=0, Wrap=True)  # -> Item1, Item
support = Support(Point=item_2.Item1, X=Toggle(True), Y=True, Z=True, XX=True, YY=True, ZZ=True, Temporary=False)
sph = Sphere(Base=[item_2.Item1, item_2.Item], Radius=0.2)

support_2 = Support(Point=item_2.Item, X=Toggle(False), Y=True, Z=True, XX=True, YY=True, ZZ=True, Temporary=False)
merge = Merge(Data1=support, Data2=support_2)

# ----
# Model Initialization
elasticroddata = ElasticRodData(Polyline=pline, Supports=merge, Forces=force, Materials=materialglobal, Kappas=True)  # -> Data, Vertices, Indexes
elasticrod = ElasticRod(Data=elasticroddata.Data)

# ----
# Solver
toggle = BooleanToggle(False)
solverequilibrium = SolverEquilibrium(Model=elasticrod, Run=toggle, Reset=Button(), graphics=0)  # -> Model, Report

# ----
# Analysis
deelasticrod = DeconstructElasticRod(Model=solverequilibrium.Model)  # -> CenterLine, Nodes, RestLengths, Stretching, Twisting, MaxBend, MinBend, SqrtBend
bnd = Bounds(Numbers=deelasticrod.SqrtBend)
dedomain = DeconstructDomain(Domain=bnd)  # -> Start, End
gradient = Gradient(
    LowerLimit=dedomain.Start,
    UpperLimit=dedomain.End,
    Parameter=deelasticrod.SqrtBend,
    stops=[0: RGB(0, 128, 0), 0.5: RGB(255, 255, 0), 1: RGB(255, 0, 0)])
mesh = Mesh(solverequilibrium.Model)
mspray = MeshSpray(Mesh=mesh, Points=deelasticrod.Nodes, Colours=gradient, SprayMode=11)
tag = TextTag(Location=deelasticrod.Nodes, Text=deelasticrod.SqrtBend, Colour=ColourSwatch(SwatchColor=RGB(0, 0, 0)))
